# Requirement set Requirements (R2023a)

## 1 [7] Autonomous Flight
The UAV shall be able to fly a preprogrammed course without pilot intervention.

## 2 [5] Payload Data Rate
The UAV shall support a payload data rate out of up to 20 Mb/s.

## 3 [8] Payload Mass
The UAV shall support a payload mass of up to 50 kg.

### 3.1 [8.1] Maximum Mass
Maximum Mass is 50 kg

### 3.2 [8.2] Minimum Mass
Minimum Mass is 0 kg

### 3.3 [8.2] Minimum Mass New
Minimum Mass is 0 kg

## 4 [6] Payload Power Demand
The UAV shall support a payload power demand of up to 1 kW.